# Grasshopper definition 3d_Grid spread.gh (Grasshopper 1.0.4)

recgrid = Rectangular(
    Plane=PlaneXY(0, 0, 0),
    SizeX=Slider(1, range=0..10),
    SizeY=Slider(1, range=0..10),
    ExtentX=Slider(30, range=0..100),
    ExtentY=Slider(50, range=0..100))  # -> Cells, Points
series = Series(Start=0, Step=1, Count=Slider(45, range=0..100))
Z = UnitZ(Factor=series)
move = Move(Geometry=graft(recgrid.Points), Motion=flatten(Z))  # -> Geometry, Transform
pt = Point(simplify(move.Geometry))
path_mapper = PathMapper(pt, source="{A;B}(i)", target="{A;i}(B)")
merge = Merge(Data1=move.Geometry, Data2=path_mapper)
bbox = BoundingBox(Content=flatten(merge), Plane=PlaneXY(0, 0, 0), UnionBox=True)  # -> Box, Box_2
pline = PolyLine(Vertices=merge, Closed=False)
pop3d = Populate3D(Region=bbox.Box, Count=Slider(37, range=0..100), Seed=1)
divide = DivideCurve(Curve=pline, Count=Slider(54, range=0..100), Kinks=False)  # -> Points, Tangents, Parameters
cp = ClosestPoint(Point=divide.Points, Cloud=pop3d)  # -> ClosestPoint, CPIndex, Distance
larger = LargerThan(FirstNumber=cp.Distance, SecondNumber=Slider(11.5, range=0..25))  # -> LargerThan, OrEqualTo
dispatch = Dispatch(List=divide.Points, DispatchPattern=larger.LargerThan)  # -> ListA, ListB
index = ItemIndex(List=divide.Points, Item=dispatch.ListB)
cp_2 = ClosestPoint(Point=dispatch.ListB, Cloud=flatten(dispatch.ListA))  # -> ClosestPoint, CPIndex, Distance
replace = ReplaceItems(List=divide.Points, Item=cp_2.ClosestPoint, Indices=index, Wrap=False)
pline_2 = PolyLine(Vertices=replace, Closed=False)
divide_2 = DivideCurve(Curve=pline_2, Count=Slider(5, range=0..100), Kinks=False)  # -> Points, Tangents, Parameters
intcrv = Interpolate(Vertices=divide_2.Points, Degree=3, Periodic=False, KnotStyle=1)  # -> Curve, Length, Domain
