# Grasshopper definition Shadow Study.gh (Grasshopper 1.0.7)
# plug-ins: Human

panel = Panel("https://energyplus-weather.s3.amazonaws.com/europe_wmo_region_6/DEU/DEU_Dusseldorf.104000_IWEC/DEU_Dusseldorf.104000_IWEC.zip")
downloadepw = LBDownloadWeather(weather_URL=panel)  # -> epw_file, stat_file, ddy_file; plug-in component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
series = Series(Start="1", Step=1, Count="23")
importepw = LBImportEPW(epw_file=downloadepw.epw_file)  # -> location, dry_bulb_temperature, dew_point_temperature, relative_humidity, wind_speed, wind_direction, direct_normal_rad, diffuse_horizontal_rad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; plug-in component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
colrange = LBColorRange(index=Slider(9, range=0..25))  # -> colors; plug-in component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
analysisperiod = LBAnalysisPeriod(
    start_month=Slider(1, range=0..100),
    start_day=Slider(17, range=0..100),
    start_hour=Slider(0, range=0..100),
    end_month=Slider(1, range=0..100),
    end_day=Slider(17, range=0..100),
    end_hour=Slider(23, range=0..100),
    timestep=Slider(1, range=0..100))  # -> period, hoys, dates; plug-in component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
hoy = LBCalculateHOY(month=graft("1"), day=Slider(30, range=0..30), hour=series)  # -> flatten(hoy), flatten(doy), flatten(date); plug-in component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
legendpar = LBLegendParameters(colors=colrange)  # -> leg_par; plug-in component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
number_slider = Slider(5, range=0..10)
sunpath = LBSunPath(location=importepw.location, hoys=analysisperiod.hoys, scale=number_slider)  # -> report, vectors, altitudes, azimuths, hoys, sun_pts, analemma, daily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; plug-in component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
sunpath_2 = LBSunPath(location=importepw.location, hoys=hoy.hoy, scale=Slider(1.24, range=0..10), legend_par=legendpar)  # -> report, vectors, altitudes, azimuths, hoys, sun_pts, analemma, daily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; plug-in component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
sunpath_3 = LBSunPath(location=importepw.location, hoys=analysisperiod.hoys, scale=number_slider)  # -> report, vectors, altitudes, azimuths, hoys, sun_pts, analemma, daily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; plug-in component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
brep = Brep(<brep referenced from the Rhino model>)
pdecon = Deconstruct(Point=sunpath.sun_pts)  # -> XComponent, YComponent, ZComponent
brep_2 = Brep([<brep referenced from the Rhino model> x7])
merge = Merge(Data1=brep_2, Data2=brep)
swatch = ColourSwatch(SwatchColor=RGB(0, 0, 0))
colrange_2 = LBColorRange(index=Slider(1, range=0..25))  # -> colors; plug-in component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
preview = CustomPreview(Material=swatch)
bnd = Bounds(Numbers=pdecon.ZComponent)
brep_3 = Brep([<brep referenced from the Rhino model> x801])
previewlw = CustomPreviewLineweights(
    Geometry=[sunpath.analemma, sunpath.daily, sunpath.compass],
    Shader=swatch,
    Thickness=Slider(0, range=0..100),
    Absolute=False)
legendpar_2 = LBLegendParameters(colors=colrange_2)  # -> leg_par; plug-in component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
directsunhours = LBDirectSunHours(
    vectors=flatten(sunpath_3.vectors),
    geometry=flatten(brep_2),
    context=flatten(merge),
    grid_size=Slider(2500, range=0..10000),
    legend_par=legendpar_2,
    run=Toggle(False))  # -> report, points, results, mesh, legend, title, int_mtx; plug-in component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
remap = RemapNumbers(Value=pdecon.ZComponent, Source=bnd, Target=Domain(0, 1))  # -> Mapped, Clipped
gradient = Gradient(LowerLimit=0, UpperLimit=1, Parameter=remap.Mapped, stops=[0: RGB(220, 0, 40), 1: RGB(255, 251, 130)])
geo = Geometry(directsunhours.mesh)
edges = BrepEdges(Brep=merge)  # -> Naked, Interior, NonManifold
geo_2 = Geometry(directsunhours.legend)
txt = Text(directsunhours.title)
group = Group(Objects=geo_2)
dots = DotDisplay(Point=sunpath.sun_pts, Colour=gradient, Size=Slider(3000, range=0..10000))
bbox = BoundingBox(Content=group, Plane=PlaneXY(0, 0, 0), UnionBox=True)  # -> Box, Box_2
previewlw_2 = CustomPreviewLineweights(
    Geometry=edges.Interior,
    Shader=ColourSwatch(SwatchColor=RGB(0, 0, 0)),
    Thickness=Slider(1.222, range=0..10),
    Absolute=False)
preview_2 = CustomPreview(Geometry=geo_2, Material=ColourSwatch(SwatchColor=RGBA(184, 184, 184, 18)))
python = PythonScript(reset=Button())  # -> out, name, direction, up
# ---------- python: Python ----------
import rhinoscriptsyntax as rs
import Rhino as rc
import scriptcontext as sc
import Rhino.Geometry as rg

# Node-in-Code import
import ghpythonlib.components as ghcomp

# Set the script context to the current Rhino doc
sc.doc = rc.RhinoDoc.ActiveDoc


direction = sc.doc.Views.ActiveView.ActiveViewport.CameraDirection
name = sc.doc.Views.ActiveView.ActiveViewport.Name
target = sc.doc.Views.ActiveView.ActiveViewport.CameraTarget
location = sc.doc.Views.ActiveView.ActiveViewport.CameraLocation
up = sc.doc.Views.ActiveView.ActiveViewport.CameraUp

    
# Then set the script context back to the Grasshopper doc
sc.doc = ghdoc
# ---------- end python ----------
srf = Surface(bbox.Box)
debrep = DeconstructBrep(Brep=srf)  # -> Faces, Edges, Vertices
xprod = CrossProduct(VectorA=python.direction, VectorB=python.up, Unitize=True)  # -> Vector, Length
panel_2 = Panel(python.name)
pt = Point(Point(-22.53801727, -164811.3649, 107200.245))
item = ListItem(List=debrep.Edges, Index=0, Wrap=True)  # -> Item, Item1, Item2
pl = ConstructPlane(Origin=pt, XAxis=xprod.Vector, YAxis=python.up)
end = EndPoints(Curve=item.Item2)  # -> Start, End
end_2 = EndPoints(Curve=item.Item)  # -> Start, End
vec2pt = Vector2Pt(PointA=end.End, PointB=end.Start, Unitize=True)  # -> Vector, Length
vec2pt_2 = Vector2Pt(PointA=end.End, PointB=end_2.Start, Unitize=True)  # -> Vector, Length
rev = Reverse(Vector=vec2pt_2.Vector)
pl_2 = ConstructPlane(Origin=end.End, XAxis=vec2pt.Vector, YAxis=rev)
orient = Orient(Geometry=group, Source=pl_2, Target=pl)  # -> Geometry, Transform
amp = Amplitude(Vector=python.up, Amplitude=Slider(134023.44, range=0..1000000))
move = Move(Geometry=orient.Geometry, Motion=amp)  # -> Geometry, Transform
bbox_2 = BoundingBox(Content=move.Geometry, Plane=PlaneXY(0, 0, 0), UnionBox=True)  # -> Box, Box_2
area = Area(Geometry=bbox_2.Box)  # -> Area, Centroid
scale = Scale(Geometry=move.Geometry, Center=area.Centroid, Factor=Slider(0.25565, range=0..1))  # -> Geometry, Transform
