# Grasshopper definition Facade (Triad).gh (Grasshopper 1.0.7)

# ---- group: Creating Main Curve
number_slider = Slider(0, range=0..100)
vec = VectorXYZ(XComponent=number_slider, YComponent=number_slider, ZComponent=number_slider)  # -> Vector, Length
Y = UnitY(Factor=1)
line = LineSDL(Start=vec.Vector, Direction=Y, Length=Slider(1094, range=0..10000))
panel = Panel("""1
0
1""")
multiplication = Multiplication(A=Slider(1, range=0..30), B=Slider(3, range=0..10))
divide = DivideCurve(Curve=line, Count=multiplication, Kinks=False)  # -> Points, Tangents, Parameters
subtraction = Subtraction(A=panel, B=1)
cull = CullPattern(List=flatten(divide.Points), CullPattern=panel)
abs = Absolute(Value=subtraction)
cull_2 = CullPattern(List=flatten(divide.Points), CullPattern=abs)
X = UnitX(Factor=Slider(259.66, range=0..350))
neg = Negative(Value=X)
move = Move(Geometry=cull, Motion=neg)  # -> Geometry, Transform
Z = UnitZ(Factor=Slider(133.24, range=0..1000))
move_2 = Move(Geometry=move.Geometry, Motion=Z)  # -> Geometry, Transform
weave = Weave(Pattern=abs, Stream0=move_2.Geometry, Stream1=cull_2, NullGaps=False)
intcrv = Interpolate(Vertices=weave, Degree=3, Periodic=False, KnotStyle=1)  # -> Curve, Length, Domain

# ----
xy = XYPlane(Origin=Point(0, 0, 0))
mirror = Mirror(Geometry=intcrv.Curve, Plane=xy)  # -> Geometry, Transform
number_slider_2 = Slider(134.24, range=0..300)
neg_2 = Negative(Value=number_slider_2)
Z_2 = UnitZ(Factor=neg_2)
move_3 = Move(Geometry=mirror.Geometry, Motion=Z_2)  # -> Geometry, Transform
addition = Addition(A=number_slider_2, B=Slider(336.26, range=0..1000))
Z_3 = UnitZ(Factor=addition)
move_4 = Move(Geometry=mirror.Geometry, Motion=Z_3)  # -> Geometry, Transform
merge = Merge(Data1=intcrv.Curve, Data2=move_4.Geometry)
loft = Loft(Curves=merge, Options={Adjust=False, Closed=False, LoftEnds=0, LoftSimp=0, LoftType=0, Rebuild=10, Refit=0.01})
X_2 = UnitX(Factor=Slider(54.44, range=0..1000))
divide_2 = DivideCurve(Curve=intcrv.Curve, Count=10, Kinks=False)  # -> Points, Tangents, Parameters
divide_3 = DivideCurve(Curve=move_3.Geometry, Count=10, Kinks=False)  # -> Points, Tangents, Parameters
divide_4 = DivideCurve(Curve=move_4.Geometry, Count=10, Kinks=False)  # -> Points, Tangents, Parameters
neg_3 = Negative(Value=X_2)
move_5 = Move(Geometry=loft, Motion=neg_3)  # -> Geometry, Transform
move_6 = Move(Geometry=intcrv.Curve, Motion=neg_3)  # -> Geometry, Transform
divide_5 = DivideCurve(Curve=move_6.Geometry, Count=10, Kinks=False)  # -> Points, Tangents, Parameters
shatter = Shatter(Curve=intcrv.Curve, Parameters=divide_2.Parameters)  # -> flatten(Segments)
shatter_2 = Shatter(Curve=move_3.Geometry, Parameters=divide_3.Parameters)  # -> flatten(Segments)
shatter_3 = Shatter(Curve=intcrv.Curve, Parameters=divide_2.Parameters)  # -> flatten(Segments)
shatter_4 = Shatter(Curve=move_6.Geometry, Parameters=divide_5.Parameters)  # -> flatten(Segments)
shatter_5 = Shatter(Curve=move_4.Geometry, Parameters=divide_4.Parameters)  # -> flatten(Segments)
shatter_6 = Shatter(Curve=move_6.Geometry, Parameters=divide_5.Parameters)  # -> flatten(Segments)
graft = GraftTree(Tree=shatter, IncludeEmptyLists=True, IncludeNullItems=True)
graft_2 = GraftTree(Tree=shatter_2, IncludeEmptyLists=True, IncludeNullItems=True)
graft_3 = GraftTree(Tree=shatter_3, IncludeEmptyLists=True, IncludeNullItems=True)
graft_4 = GraftTree(Tree=shatter_4, IncludeEmptyLists=True, IncludeNullItems=True)
graft_5 = GraftTree(Tree=shatter_5, IncludeEmptyLists=True, IncludeNullItems=True)
graft_6 = GraftTree(Tree=shatter_6, IncludeEmptyLists=True, IncludeNullItems=True)
loft_2 = Loft(
    Curves=[graft, graft_2],
    Options={Adjust=False, Closed=False, LoftEnds=0, LoftSimp=0, LoftType=0, Rebuild=10, Refit=0.01})
loft_3 = Loft(
    Curves=[graft_3, graft_4],
    Options={Adjust=False, Closed=False, LoftEnds=0, LoftSimp=0, LoftType=0, Rebuild=10, Refit=0.01})
loft_4 = Loft(
    Curves=[graft_5, graft_6],
    Options={Adjust=False, Closed=False, LoftEnds=0, LoftSimp=0, LoftType=0, Rebuild=10, Refit=0.01})
debrep = DeconstructBrep(Brep=loft_2)  # -> Faces, Edges, Vertices
debrep_2 = DeconstructBrep(Brep=loft_3)  # -> Faces, Edges, Vertices
debrep_3 = DeconstructBrep(Brep=loft_4)  # -> Faces, Edges, Vertices
srf = Surface(debrep.Faces)
srf_2 = Surface(debrep_2.Faces)
srf_3 = Surface(debrep_3.Faces)
dom²num = ConstructDomain²(
    UMin=Slider(0.10856, range=0..1),
    UMax=Slider(0.95, range=0..1),
    VMin=Slider(0.1, range=0..1),
    VMax=Slider(0.9, range=0..1))
dom = ConstructDomain(DomainStart=Slider(0.18821, range=0..1), DomainEnd=Slider(0.52261, range=0..1))
dom_2 = ConstructDomain(DomainStart=Slider(0.21831, range=0..1), DomainEnd=Slider(0.79095, range=0..1))
div = DivideDomain(Domain=dom, Count=Slider(5, range=0..10))
subsrf = Isotrim(Surface=reparameterize(srf_3), Domain=dom²num)
dom_3 = ConstructDomain(DomainStart=Slider(0, range=0..1), DomainEnd=Slider(1, range=0..1))
dom_4 = ConstructDomain(DomainStart=Slider(0.005, range=0..1), DomainEnd=Slider(0.995, range=0..1))
panel_2 = Panel("""0
1
0""")
dom² = ConstructDomain²(DomainU=div, DomainV=dom_2)
subsrf_2 = Isotrim(Surface=reparameterize(srf_2), Domain=dom²)
dom²_2 = ConstructDomain²(DomainU=dom_3, DomainV=dom_4)
number_slider_3 = Slider(5, range=0..10)
cull_3 = CullPattern(List=subsrf_2, CullPattern=panel_2)
subsrf_3 = Isotrim(Surface=reparameterize(srf), Domain=dom²_2)
sdiff = SolidDifference(BrepsA=srf_2, BrepsB=cull_3)
sdiff_2 = SolidDifference(BrepsA=srf_3, BrepsB=subsrf)
brep = Brep(subsrf)
group = Group(Objects=brep)
series = Series(Start=0, Step=Slider(607.547, range=200..800), Count=10)
Z_4 = UnitZ(Factor=series)
move_7 = Move(Geometry=group, Motion=Z_4)  # -> Geometry, Transform
series_2 = Series(Start=0, Step=Slider(1096.693, range=700..1200), Count=Slider(4, range=0..10))
group_2 = Group(Objects=move_7.Geometry)
Y_2 = UnitY(Factor=series_2)
move_8 = Move(Geometry=group_2, Motion=Y_2)  # -> Geometry, Transform
