# Grasshopper definition Graphic_ Constrast Strips.gh (Grasshopper 0.9.76)
# plug-ins: Python Interpreter

# ---- group: Minimum Spacing
number_slider = Slider(0.09, range=0..0.2)

# ----
number_slider_2 = Slider(3.5, range=0..10)
division = Division(A=number_slider_2, B=Slider(3, range=0..10))
recgrid = Rectangular(
    Plane=PlaneXY(15, 683, 0),
    SizeX=number_slider_2,
    SizeY=number_slider_2,
    ExtentX=Slider(140, range=0..600),
    ExtentY=Slider(150, range=0..400))  # -> Cells, Points
image = ImageSampler(
    recgrid.Points,
    FilePath="C:\Users\DELL\Desktop\f53187d496d8fc0038372952069beca9.jpg",
    Filter="Value",
    Interpolate=False,
    Umax=466,
    Umin=1,
    Vmax=600,
    Vmin=1,
    Wrap=1)

# ---- group: Maximum Spacing
subtraction = Subtraction(A=division, B=Slider(0.058, range=0..0.1))

# ----
bnd = Bounds(Numbers=image)
dom = ConstructDomain(DomainStart=number_slider, DomainEnd=subtraction)
remap = RemapNumbers(Value=image, Source=bnd, Target=dom)  # -> Mapped, Clipped
pt = Point(recgrid.Points)
python = PythonScript(x=remap.Mapped)  # -> out, a
# ---------- python: Python ----------
import rhinoscriptsyntax as rs

if x<=0.25:
    a = .1
elif 0.25<x<0.5:
    a = 0.25
elif 0.5<x<0.75:
    a = 0.5;
else:
    a = 0.75
# ---------- end python ----------
X = UnitX(Factor=python.a)
X_2 = UnitX(Factor=python.a)
neg = Negative(Value=X_2)
move = Move(Geometry=pt, Motion=X)  # -> Geometry, Transform
move_2 = Move(Geometry=pt, Motion=neg)  # -> Geometry, Transform
intcrv = Interpolate(Vertices=move.Geometry, Degree=3, Periodic=False, KnotStyle=1)  # -> Curve, Length, Domain
intcrv_2 = Interpolate(Vertices=move_2.Geometry, Degree=3, Periodic=False, KnotStyle=1)  # -> Curve, Length, Domain
loft = Loft(
    Curves=[intcrv.Curve, intcrv_2.Curve],
    Options={Adjust=False, Closed=False, LoftEnds=0, LoftSimp=0, LoftType=0, Rebuild=10, Refit=0.01})
preview = CustomPreview(Geometry=loft, Shader=ColourSwatch(SwatchColor=RGB(255, 255, 255)))
