# Grasshopper definition 210922 landscape StairsRamp.gh (Grasshopper 1.0.7)

number_slider = Slider(35, range=0..100)
number_slider_2 = Slider(8, range=0..15)
number_slider_3 = Slider(150, range=0..1000)
crv = Curve(<curve referenced from the Rhino model>)
python = GhPythonScript(div=number_slider_2, start=Slider(2, range=0..10), end=Slider(3, range=0..10))  # -> out, a, pattern; inputs div: Int32, start: Int32, end: Int32
# ---------- python: Python ----------
__author__ = "ashkan.rezaee"
__version__ = "2021.09.22"

import rhinoscriptsyntax as rs

steps = (div - end) - start + 1

a = []
pattern = []
tempPat = []

for i in range(steps):
    a.append(start + i)
for j in range(steps - 1):
    a.append(div - end - j -1)

for i in range(len(a)):
    lp_1 = a[i]
    lp_0 = abs(div - a[i])
    
    for i in range(lp_1):
        pattern.append(1)
        tempPat.append(1)
    for j in range(lp_0):
        pattern.append(0)
        tempPat.append(0)

for i in range(div):
    pattern.append(0)

for i in range(len(tempPat)):
    nPat = tempPat[len(tempPat) - i -1]
    pattern.append(nPat)
    
    
#a.append(div)
# ---------- end python ----------
python_2 = GhPythonScript(crv=crv, extrudVal=Slider(668.38, range=0..1000), rep=number_slider, div=number_slider_2)  # -> out, breps, move; inputs crv: Curve, rep: Int32
# ---------- python_2: Python ----------
__author__ = "ashkan.rezaee"
__version__ = "2021.09.22"

import rhinoscriptsyntax as rs
import Rhino.Geometry as rg

allEx = []
breps = []

crvPt = rs.DivideCurve(crv, div)
endCrv = rs.CurveEndPoint(crv)
stCrv = rs.CurveStartPoint(crv)
xVec = rs.VectorUnitize(endCrv - stCrv)
yVec = rs.VectorUnitize(rs.VectorCrossProduct(rg.Vector3d(0,0,1), xVec))

for i,e in enumerate(crvPt):
    if(i < len(crvPt) -1):
        crvDr = rs.AddLine(e, crvPt[i+1])
        crvMid = rs.CurveMidPoint(crvDr)
        line = rs.AddLine(crvMid, crvMid + extrudVal * yVec)
        crvEx = rs.ExtrudeCurve(crvDr, line)
        allEx.append(crvEx)
        
for i,e in enumerate(allEx):
    for j in range(rep):
        move = j * yVec * extrudVal
        breps.append(rs.CopyObject(e,move))
# ---------- end python_2 ----------
partition = PartitionList(List=python_2.breps, Size=number_slider)
flip = FlipMatrix(Data=partition)  # -> flatten(Data)
cull = CullPattern(List=flatten(flip), CullPattern=python.pattern)
partition_2 = PartitionList(List=cull, Size=python.a)
tstat = TreeStatistics(Tree=partition_2)  # -> Paths, Length, Count
series = Series(Start=0, Step=number_slider_3, Count=tstat.Count)
Z = UnitZ(Factor=series)  # -> simplify(graft(UnitVector))
Z_2 = UnitZ(Factor=number_slider_3)
move = Move(Geometry=partition_2, Motion=Z)  # -> Geometry, Transform
extr = Extrude(Base=flatten(move.Geometry), Direction=Z_2)
edges = BrepEdges(Brep=extr)  # -> Naked, Interior, NonManifold
preview = CustomPreview(Geometry=extr, Material=ColourSwatch(SwatchColor=RGB(255, 255, 255)))
