# Grasshopper definition Landscape Slabs.gh (Grasshopper 1.0.7)

srf = Surface(<surface referenced from the Rhino model>)
cluster = Cluster(
    gap=Slider(150, range=0..150),
    extrusion=Slider(100, range=0..300),
    surface=srf,
    minimum_length=Slider(0.1234, range=0..1),
    maximum_length=Slider(0.9, range=0..1),
    lengthdivide=Slider(700, range=0..10000),
    seed=Slider(7, range=0..10),
    thickness=Slider(100, range=0..100),
    reduction_percentage=Slider(0.1, range=0..1))
edges = BrepEdges(Brep=cluster)  # -> Naked, Interior, NonManifold
geo = Geometry(cluster)
preview = CustomPreview(Geometry=cluster, Material=ColourSwatch(SwatchColor=RGBA(93, 150, 86, 170)))
preview_2 = CustomPreview(Geometry=edges.Interior, Material=ColourSwatch(SwatchColor=RGB(20, 19, 19)))

# ==== cluster Cluster
surface = ClusterInput()  # A Surface
debrep = DeconstructBrep(Brep=surface)  # -> Faces, graft(Edges), Vertices
bang = ExplodeTree(Data=debrep.Edges)  # -> Branch0, Branch1, Branch2, Branch3
flip = FlipCurve(Curve=bang.Branch1)  # -> Curve, Flag
lengthdivide = ClusterInput()  # Divide the length
divlength = DivideLength(Curve=flip.Curve, Length=lengthdivide)  # -> Points, Tangents, Parameters
divlength_2 = DivideLength(Curve=bang.Branch3, Length=lengthdivide)  # -> Points, Tangents, Parameters
ln = Line(StartPoint=divlength.Points, EndPoint=divlength_2.Points)  # -> simplify(flatten(Line))
shift = ShiftList(List=ln, Shift=1, Wrap=False)  # -> flatten(List)
merge = Merge(Data1=graft(ln), Data2=graft(shift))
loft = Loft(Curves=merge, Options={Adjust=False, Closed=False, LoftEnds=0, LoftSimp=0, LoftType=0, Rebuild=10, Refit=0.01})  # -> flatten(Loft)
clean = CleanTree(RemoveNulls=True, RemoveInvalid=True, RemoveEmpty=False, Tree=loft)
srf = Surface(clean)
debrep_2 = DeconstructBrep(Brep=srf)  # -> Faces, Edges, Vertices
item = ListItem(List=debrep_2.Edges, Index=Slider(1, range=0..10), Wrap=True)  # -> flatten(Item)
item_2 = ListItem(List=debrep_2.Edges, Index=Slider(2, range=0..10), Wrap=True)  # -> flatten(Item)
item_3 = ListItem(List=debrep_2.Edges, Index=0, Wrap=True)  # -> flatten(Item)
topoly = CurveToPolyline(Curve=item, ToleranceDistance=0, ToleranceAngle=0)  # -> Polyline, Segments
topoly_2 = CurveToPolyline(Curve=item_2, ToleranceDistance=0, ToleranceAngle=0)  # -> Polyline, Segments
curvepoint = PointOnCurve(item_2, parameter=0.5)
curvepoint_2 = PointOnCurve(item_3, parameter=0.5)
line = Line(topoly.Polyline)
line_2 = Line(topoly_2.Polyline)
gap = ClusterInput()  # Gap length
lnln = LineLine(LineA=line, LineB=line_2)
ln_2 = Line(StartPoint=curvepoint_2, EndPoint=curvepoint)
len = Length(Curve=ln_2)
subtraction = Subtraction(A=len, B=gap)
division = Division(A=subtraction, B=len)
scale_nu = ScaleNU(Geometry=srf, Plane=lnln, ScaleX=1, ScaleY=division, ScaleZ=1)  # -> Geometry, Transform
debrep_3 = DeconstructBrep(Brep=scale_nu.Geometry)  # -> Faces, Edges, Vertices
item_4 = ListItem(List=debrep_3.Edges, Index=Slider(1, range=0..10), Wrap=True)
curvepoint_3 = PointOnCurve(item_4, parameter=0.5)
end = EndPoints(Curve=item_4)  # -> flatten(Start), flatten(End)
weave = Weave(Pattern=[0, 1], Stream0=end.Start, Stream1=end.End, NullGaps=False)
clean_2 = CleanTree(RemoveNulls=True, RemoveInvalid=True, RemoveEmpty=False, Tree=weave)
reduction_percentage = ClusterInput()  # Reduction Percentage
lng = ListLength(List=clean_2)
number_slider = Slider(7, range=0..10)
expression = Expression(x=lng, y=reduction_percentage, Expression="y* x")
seed = ClusterInput()
int = Integer(expression)
reduce = RandomReduce(List=clean_2, Reduction=int, Seed=seed)
cp = ClosestPoint(Point=reduce, Cloud=flatten(curvepoint_3))  # -> ClosestPoint, CPIndex, Distance
minimum_length = ClusterInput()
maximum_length = ClusterInput()
ln_3 = Line(StartPoint=reduce, EndPoint=cp.ClosestPoint)
lng_2 = ListLength(List=ln_3)
dom = ConstructDomain(DomainStart=minimum_length, DomainEnd=maximum_length)
random = Random(Range=dom, Number=lng_2, Seed=2)
scale = Scale(Geometry=ln_3, Center=reduce, Factor=random)  # -> Geometry, Transform
thickness = ClusterInput()  # Thickness
neg = Negative(Value=thickness)
end_2 = EndPoints(Curve=scale.Geometry)  # -> Start, End
offset = OffsetCurve(Curve=scale.Geometry, Distance=neg, Plane=PlaneXY(0, 0, 0), Corners=1)
offset_2 = OffsetCurve(Curve=scale.Geometry, Distance=thickness, Plane=PlaneXY(0, 0, 0), Corners=1)
end_3 = EndPoints(Curve=offset)  # -> Start, End
end_4 = EndPoints(Curve=offset_2)  # -> Start, End
cir = Circle(Plane=end_2.End, Radius=thickness)
ln_4 = Line(StartPoint=end_3.Start, EndPoint=end_4.Start)
ln_5 = Line(StartPoint=end_3.End, EndPoint=end_4.End)
join = JoinCurves(Curves=[offset, ln_4, offset_2, ln_5], Preserve=False)
Z = UnitZ(Factor=1)
trim = TrimWithRegion(Curve=graft(cir), Region=join, Plane=Z)  # -> Inside, Outside
extrusion = ClusterInput()  # Extrusion
crv = Curve(trim.Outside)
join_2 = JoinCurves(Curves=flatten([offset, ln_4, offset_2, crv]), Preserve=False)
boundary = BoundarySurfaces(Edges=join_2)  # -> flatten(Surfaces)
multiplication = Multiplication(A=extrusion, B=4)
Z_2 = UnitZ(Factor=extrusion)
Z_3 = UnitZ(Factor=multiplication)
extr = Extrude(Base=scale_nu.Geometry, Direction=Z_2)
extr_2 = Extrude(Base=boundary, Direction=Z_3)
sdiff = SolidDifference(BrepsA=extr, BrepsB=extr_2)
geometry = ClusterOutput(sdiff)
