# Grasshopper definition Parametric spiral stairs.gh (Grasshopper 1.0.7)

width = Slider(1000, range=0..2000)
number_slider = Slider(22, range=0..100)
cir = Circle(Plane=PlaneXY(0, 0, 0), Radius=Slider(1100, range=0..2000))
offset = OffsetCurve(Curve=cir, Distance=width, Plane=PlaneXY(0, 0, 0), Corners=1)
divide = DivideCurve(Curve=cir, Count=number_slider, Kinks=False)  # -> Points, Tangents, Parameters
number_slider_2 = Slider(19.44, range=0..100)
shatter = Shatter(Curve=cir, Parameters=divide.Parameters)
curvepoint = PointOnCurve(shatter, parameter=0.5)
len = Length(Curve=shatter)
divide_2 = DivideCurve(Curve=offset, Count=number_slider, Kinks=False)  # -> Points, Tangents, Parameters
tag = TextTag3D(Location=curvepoint, Text=len, Size=number_slider_2, Justification=7)
dots = DotDisplay(Point=curvepoint, Colour=RGB(69, 230, 80), Size=number_slider_2)
ln = Line(StartPoint=divide.Points, EndPoint=divide_2.Points)  # -> flatten(Line)
shatter_2 = Shatter(Curve=offset, Parameters=divide_2.Parameters)
merge = Merge(Data1=graft(shatter), Data2=graft(shatter_2))
number_slider_3 = Slider(175, range=0..1000)
loft = Loft(Curves=merge, Options={Adjust=False, Closed=False, LoftEnds=0, LoftSimp=0, LoftType=0, Rebuild=10, Refit=0.01})  # -> simplify(flatten(Loft))
lng = ListLength(List=loft)
series = Series(Start=number_slider_3, Step=number_slider_3, Count=lng)
Z = UnitZ(Factor=series)
move = Move(Geometry=loft, Motion=Z)  # -> Geometry, Transform
Z_2 = UnitZ(Factor=number_slider_3)
neg = Negative(Value=Z_2)
extr = Extrude(Base=move.Geometry, Direction=neg)
debrep = DeconstructBrep(Brep=extr)  # -> Faces, Edges, Vertices
item = ListItem(List=debrep.Edges, Index=Slider(4, range=0..10), Wrap=True)  # -> flatten(Item)
item_2 = ListItem(List=debrep.Edges, Index=Slider(6, range=0..10), Wrap=True)  # -> flatten(Item)
number_slider_4 = Slider(80, range=0..100)
loft_2 = Loft(Curves=item_2, Options={Adjust=False, Closed=False, LoftEnds=0, LoftSimp=0, LoftType=0, Rebuild=10, Refit=0.01})
loft_3 = Loft(Curves=item, Options={Adjust=False, Closed=False, LoftEnds=0, LoftSimp=0, LoftType=0, Rebuild=10, Refit=0.01})
offset_2 = OffsetSurface(Surface=loft_3, Distance=number_slider_4, Retrim=True)
offset_3 = OffsetSurface(Surface=loft_2, Distance=number_slider_4, Retrim=True)
loft_4 = Loft(
    Curves=[loft_3, offset_2],
    Options={Adjust=False, Closed=False, LoftEnds=0, LoftSimp=0, LoftType=0, Rebuild=10, Refit=0.01})
loft_5 = Loft(
    Curves=[loft_2, offset_3],
    Options={Adjust=False, Closed=False, LoftEnds=0, LoftSimp=0, LoftType=0, Rebuild=10, Refit=0.01})
join = BrepJoin(Breps=[offset_2, loft_3, loft_4])  # -> Breps, Closed
join_2 = BrepJoin(Breps=[offset_3, loft_2, loft_5])  # -> Breps, Closed
neg_2 = Negative(Value=number_slider_3)
Z_3 = UnitZ(Factor=neg_2)
move_2 = Move(Geometry=join.Breps, Motion=Z_3)  # -> Geometry, Transform
move_3 = Move(Geometry=join_2.Breps, Motion=Z_3)  # -> Geometry, Transform
merge_2 = Merge(Data1=join.Breps, Data3=move_2.Geometry)
merge_3 = Merge(Data1=join_2.Breps, Data3=move_3.Geometry)
number_slider_5 = Slider(31, range=0..100)
sunion = SolidUnion(Breps=merge_2)  # -> simplify(Result)
sunion_2 = SolidUnion(Breps=merge_3)  # -> simplify(Result)
number_slider_6 = Slider(400, range=0..10000)
boxrec = BoxRectangle(
    Rectangle={Plane=PlaneXY(4.39828205, 441.5862621, 0), Size=Domain2(u=-4723.036655..4723.036655, v=-4568.453859..4568.453859)},
    Height=Domain(-1000, 0))
debrep_2 = DeconstructBrep(Brep=loft_3)  # -> Faces, Edges, Vertices
debrep_3 = DeconstructBrep(Brep=loft_2)  # -> Faces, Edges, Vertices
sdiff = SolidDifference(BrepsA=graft(sunion), BrepsB=boxrec)
sdiff_2 = SolidDifference(BrepsA=graft(sunion_2), BrepsB=boxrec)
item_3 = ListItem(List=debrep_2.Edges, Index=0, Wrap=True)
item_4 = ListItem(List=debrep_3.Edges, Index=Slider(2, range=0..10), Wrap=True)
divide_3 = DivideCurve(Curve=item_3, Count=number_slider_5, Kinks=False)  # -> Points, Tangents, Parameters
divide_4 = DivideCurve(Curve=item_4, Count=number_slider_5, Kinks=False)  # -> Points, Tangents, Parameters
brep = Brep([sdiff, sdiff_2])
line = LineSDL(Start=divide_3.Points, Direction=Vector(0, 0, 1), Length=number_slider_6)
line_2 = LineSDL(Start=divide_4.Points, Direction=Vector(0, 0, 1), Length=number_slider_6)
Z_4 = UnitZ(Factor=number_slider_6)
crv = Curve([line, line_2])
move_4 = Move(Geometry=[item_3, item_4], Motion=Z_4)  # -> Geometry, Transform
pipe = Pipe(Curve=crv, Radius=Slider(7.301, range=0..10), Caps=0)
pipe_2 = Pipe(Curve=move_4.Geometry, Radius=Slider(22.5, range=0..25), Caps=0)
