# Grasshopper definition Point Attractor.gh (Grasshopper 1.0.4)

# ---- group: BOX GRID
space_factor = Slider(0.53, range=0..1)
# patreon.com/ashkanism
# Generating Box Grid
height = Slider(25, range=0..25)
division = Slider(10, range=0..50)
expression = Expression(x=height, y=division, spFactor=space_factor, Expression="x/y - spFactor*(x/y)")
expression_2 = Expression(x=height, y=division, spFactor=space_factor, Expression="x/y + 0.1*(x/y)")
num = Number(expression_2)
box = CenterBox(Base=PlaneXY(0, 0, 0), X=expression, Y=expression, Z=expression)
series = Series(Start=0, Step=num, Count=division)
Z = UnitZ(Factor=series)
move = Move(Geometry=box, Motion=Z)  # -> Geometry, Transform
series_2 = Series(Start=0, Step=num, Count=division)
X = UnitX(Factor=series_2)
move_2 = Move(Geometry=graft(move.Geometry), Motion=X)  # -> Geometry, Transform
series_3 = Series(Start=0, Step=num, Count=division)
Y = UnitY(Factor=series_3)
move_3 = Move(Geometry=graft(move_2.Geometry), Motion=Y)  # -> Geometry, Transform

# ----
# Attraction Point Within Boundries
number_slider = Slider(0.348, range=0..1)
multiplication = Multiplication(A=Slider(0.731, range=0..1), B=height)
multiplication_2 = Multiplication(A=Slider(0.436, range=0..1), B=height)
multiplication_3 = Multiplication(A=number_slider, B=height)
pt = ConstructPoint(XCoordinate=multiplication_3, YCoordinate=multiplication, ZCoordinate=multiplication_2)

# ----
# Scaling Based on Distances
area = Area(Geometry=flatten(move_3.Geometry))  # -> Area, Centroid
dist = Distance(PointA=area.Centroid, PointB=pt)
bnd = Bounds(Numbers=dist)
dom = ConstructDomain(DomainStart=Slider(0.01, range=0..3), DomainEnd=Slider(1, range=0..1))
remap = RemapNumbers(Value=dist, Source=bnd, Target=dom)  # -> Mapped, Clipped
graph = GraphMapper(
    remap.Mapped,
    x0=0,
    x1=1,
    y0=0,
    y1=1,
    container_name="Bezier",
    cpx=[0, 0.6827701926, 0.122907117, 1],
    cpy=[0, 0.1325066686, 0.872856915, 1])
scale = Scale(Geometry=flatten(move_3.Geometry), Center=area.Centroid, Factor=graph)  # -> Geometry, Transform

# ----
# Coloring The Geometris Based on Distances
number_slider_2 = Slider(0.395, range=0..1)
dom_2 = ConstructDomain(DomainStart=number_slider_2, DomainEnd=Slider(0.672, range=0..1))
remap_2 = RemapNumbers(Value=dist, Source=bnd, Target=dom_2)  # -> Mapped, Clipped
hsl = ColourHSL(Alpha=0.2, Hue=remap_2.Mapped, Saturation=1, Luminance=0.5)
preview = CustomPreview(Geometry=scale.Geometry, Shader=hsl)
